# Dynamo graph FloorPlanGenerator.dyn (Dynamo 2.13.0.3265)
# Automatically creates floor plans for all levels with proper view templates and crop regions

levels = Levels()  # nothing selected
python = Python()  # unwired: IN[0], IN[1], IN[2], IN[3], IN[4]
# ---------- python.python (93 lines) ----------
# Floor Plan Generator with Advanced Options
import clr
clr.AddReference('RevitAPI')
clr.AddReference('RevitServices')
clr.AddReference('RevitNodes')

from Autodesk.Revit.DB import *
from RevitServices.Persistence import DocumentManager
from RevitServices.Transactions import TransactionManager
import Revit
clr.ImportExtensions(Revit.GeometryConversion)

# Get current document
doc = DocumentManager.Instance.CurrentDBDocument

# Inputs
levels = UnwrapElement(IN[0])
view_template_name = IN[1]
view_prefix = IN[2]
crop_offset = IN[3]
create_ceiling = IN[4]

# Find view template
view_templates = FilteredElementCollector(doc).OfClass(View).ToElements()
template = None
for vt in view_templates:
    if vt.IsTemplate and vt.Name == view_template_name:
        template = vt
        break

# Start transaction
TransactionManager.Instance.EnsureInTransaction(doc)

created_views = []
report_lines = []

for level in levels:
    try:
        # Create floor plan
        view_fam_type = doc.GetDefaultElementTypeId(ElementTypeGroup.ViewTypeFloorPlan)
        floor_plan = ViewPlan.Create(doc, view_fam_type, level.Id)
        
        # Set view name
        floor_plan.Name = view_prefix + level.Name
        
        # Apply template if found
        if template:
            floor_plan.ViewTemplateId = template.Id
            report_lines.append(f"Created floor plan for {level.Name} with template")
        else:
            report_lines.append(f"Created floor plan for {level.Name} without template")
        
        # Set crop region if needed
        if floor_plan.CropBoxActive:
            # Get building extents and add offset
            # This is simplified - real implementation would calculate actual extents
            crop_box = floor_plan.CropBox
            transform = crop_box.Transform
            min_pt = crop_box.Min
            max_pt = crop_box.Max
            
            # Add offset
            offset_vec = XYZ(crop_offset, crop_offset, 0)
            new_min = min_pt - offset_vec
            new_max = max_pt + offset_vec
            
            crop_box.Min = new_min
            crop_box.Max = new_max
            floor_plan.CropBox = crop_box
        
        created_views.append(floor_plan)
        
        # Create ceiling plan if requested
        if create_ceiling:
            ceiling_type = doc.GetDefaultElementTypeId(ElementTypeGroup.ViewTypeCeilingPlan)
            ceiling_plan = ViewPlan.Create(doc, ceiling_type, level.Id)
            ceiling_plan.Name = "RCP - " + level.Name
            if template:
                ceiling_plan.ViewTemplateId = template.Id
            created_views.append(ceiling_plan)
            report_lines.append(f"Created ceiling plan for {level.Name}")
            
    except Exception as e:
        report_lines.append(f"Failed to create view for {level.Name}: {str(e)}")

# End transaction
TransactionManager.Instance.TransactionTaskDone()

# Prepare outputs
view_count = len(created_views)
report = "\n".join(report_lines)

OUT = [created_views, view_count, report]
# ----------------------------------------
codeBlock = CodeBlock()  # unwired: output
# ---------- codeBlock.designscript (4 lines) ----------
// Extract outputs
views = output[0];
count = output[1];
report = output[2];
# ----------------------------------------
