# Dynamo graph ParameterValuePropagator.dyn (Dynamo 2.13.0.3265)
# Copy parameter values between elements with advanced filtering and mapping options

codeBlock = CodeBlock()  # unwired: sourceElements, targetElements, parameterNames
# ---------- codeBlock.designscript (12 lines) ----------
// Parameter Value Propagator Logic
// This node handles the core copying logic

// Get parameters from source
sourceParams = Element.GetParameterValueByName(sourceElements, parameterNames);

// Apply to targets with validation
result = Element.SetParameterByName(targetElements, parameterNames, sourceParams);

// Track success and failures
successCount = List.Count(result);
failedParams = List.FilterByBoolMask(parameterNames, result);
# ----------------------------------------
python = Python()  # unwired: IN[0], IN[1], IN[2], IN[3]
# ---------- python.python (41 lines) ----------
import clr
clr.AddReference('RevitAPI')
clr.AddReference('RevitServices')
from RevitServices.Persistence import DocumentManager
from RevitServices.Transactions import TransactionManager

doc = DocumentManager.Instance.CurrentDBDocument

# Input processing
source_elements = UnwrapElement(IN[0])
target_elements = UnwrapElement(IN[1])
parameter_names = IN[2]
overwrite = IN[3]

# Start transaction
TransactionManager.Instance.EnsureInTransaction(doc)

success_count = 0
failed_params = []
modified_elements = []

for target in target_elements:
    for param_name in parameter_names:
        try:
            # Get source parameter value
            source_param = source_elements[0].LookupParameter(param_name)
            if source_param:
                target_param = target.LookupParameter(param_name)
                if target_param and not target_param.IsReadOnly:
                    if overwrite or not target_param.HasValue:
                        target_param.Set(source_param.AsString())
                        success_count += 1
                        if target not in modified_elements:
                            modified_elements.append(target)
        except:
            failed_params.append(param_name)

# End transaction
TransactionManager.Instance.TransactionTaskDone()

OUT = [success_count, failed_params, modified_elements]
# ----------------------------------------
